# Grasshopper definition DRVaa.gh (Grasshopper 1.0.8)
# plug-ins: CORE.Toolbox.Grasshopper, Pufferfish, Urbano, Human

# ---- group: INPUT
path = FilePath("C:\Users\l03063058\Desktop\Github\DRVaa\Grasshopper\cityModels\SJO_match_large.osm")
panel = Panel(path)

# ----
# URBANO 1
panel_2 = Panel(path)

# ---- group: CSV file with perception data for each street segment (through LLM or participatory design)
path_2 = FilePath("C:\Users\l03063058\Desktop\Github\DRVaa\street_segments_scored_360_2.csv")

# ----
importosm = ImportOSMFeatures(OSMPathOrURL=path, OSMFeatureType="building", Format="xml", ImportAltitude=False)  # -> Points, Metadata, UTMZone, TranslationVector
importosm_2 = ImportOSMFeatures(OSMPathOrURL=path, OSMFeatureType="street", Format="xml", ImportAltitude=False)  # -> Points, Metadata, UTMZone, TranslationVector
importosm_3 = ImportOSMFeatures(OSMPathOrURL=path, OSMFeatureType="amenity", Format="xml", ImportAltitude=False)  # -> Points, Metadata, UTMZone, TranslationVector
pline = PolyLine(Vertices=importosm_2.Points, Closed=False)
pline_2 = PolyLine(Vertices=importosm.Points, Closed=invert(False))
amen = CreateAmenity(PointLocationOfAmenity=importosm_3.Points, Metadata=importosm_3.Metadata)
streetnet = CreateStreetNetwork(
    StreetCurves=flatten(pline),
    Metadata=flatten(importosm_2.Metadata),
    SplitStreetCurves=True,
    UTMZone=importosm_2.UTMZone,
    TranslationVector=importosm_2.TranslationVector)  # -> StreetNetwork, StreetSegmentCurves, UTMZone, TranslationVector
bldg = CreateBuilding(BuildingCurve=pline_2, Metadata=importosm.Metadata, AmenitiesInBuilding=amen)
model = BuildUrbanoModel(Buildings=flatten(bldg), StreetNetwork=streetnet.StreetNetwork, BuildToggle=False)  # -> UrbanoModel, BuildingCurves, Activities
inbldg = InspectBuilding(Building=bldg, UrbanoModel=model.UrbanoModel, DefaultHeight=10)  # -> Geometry, Metadata, Amenity, flatten(BuildingMesh)

panel_3 = Panel(path_2)
path_3 = FilePath("C:\Users\l03063058\Desktop\Github\DRVaa\SHPs\streets_scored_SJO_large\street_scored.shp")
panel_4 = Panel(path_3)

# ---- group: CSV to SHP v003
py3 = Python3Script(csv_file=path_2, shp_file_path=path_3)  # -> GeoDataFrame, shp_file
#   port csv_file: CSV file with perception data (machine or human) for each street segment. File should include columns named latitude and longitude so it can georeference each street segment and convert to SHP file.
#   port shp_file_path: Select file path where SHP file will be saved.
# ---------- py3: Python ----------
#! python3
#r: pandas, geopandas

import pandas as pd
import geopandas as gpd
from shapely.geometry import Point

# Read CSV file
df = pd.read_csv(csv_file)


# Make sure CSV file has columns for latitud and longitud
# if 'latitude' not in df.columns or 'longitude' not in df.columns:
    # raise ValueError("CSV file must have 'latitude' and 'longitude' columns")
    

# Create point geometry based on coordinates
geometry = [Point(xy) for xy in zip(df['longitude'], df['latitude'])]
gdf = gpd.GeoDataFrame(df, geometry=geometry)

# Establish reference system (CRS), WGS84 for example
gdf.set_crs(epsg=4326, inplace=True)

# Display dataframe
GeoDataFrame = gdf

# Save as Shapefile
gdf.to_file(shp_file_path)

shp_file = shp_file_path

# print(GeoDataFrame.crs)
# ---------- end py3 ----------

# ----
number_slider = Slider(0.1, range=0..1)
panel_5 = Panel(py3.GeoDataFrame)
crvtoscreen = RenderCurveToScreen(
    Curve=streetnet.StreetSegmentCurves,
    Location="50,900",
    ScaleFactor=number_slider,
    Color=ColourSwatch(SwatchColor=RGB(255, 255, 255)),
    Thickness=1,
    Depth=".98",
    Fixed=True,
    m_scWithvp=False)
swatch = ColourSwatch(SwatchColor=RGBA(2, 124, 153, 177))
swatch_2 = ColourSwatch(SwatchColor=RGB(38, 137, 117))
swatch_3 = ColourSwatch(SwatchColor=RGB(98, 103, 104))
pt = Point(Point(985.9987441, 1851.366707, 0))
pt_2 = Point(Point(643.6389212, 2703.856789, 0))

# ---- group: SHP to GeoDataframe
py3_2 = Python3Script(SHP=py3.shp_file)  # -> GeoDataFrame
# ---------- py3_2: Python ----------
#! python3
#r: geopandas


#THIS IS NECESSARY TO LOAD PANDAS otherwise it bugs
import locale
locale.setlocale(locale.LC_ALL, 'en_US')

import geopandas as gpd

GeoDataFrame = gpd.read_file(SHP)
# ---------- end py3_2 ----------

# ----
argb = SplitARGB(Colour=swatch_3, IntegerChannels=True)  # -> Alpha, Red, Green, Blue

# ---- group: RESULTADOS / Huellas de edificios
crv = Curve(inbldg.Geometry)

# ---- group: RESULTADOS / Volumetrías
geo = Geometry(inbldg.BuildingMesh)

# ---- group: RESULTADOS / Red de calles
crv_2 = Curve(streetnet.StreetSegmentCurves)

# ---- group: Generate streets
swatch_4 = ColourSwatch(SwatchColor=RGB(0, 74, 117))
previewlw = CustomPreviewLineweights(Geometry=crv_2, Shader=swatch_3, Absolute=False)

# ---- group: Origin vs Destination
pt_3 = Point(pt_2)
pt_4 = Point(pt)
dot = AnnotationDot(Location=pt_3, PrimaryText="Origin", TextHeight=Slider(12, range=0..100))  # -> AnnotationDot, Location, PrimaryText, SecondaryText, TextHeight, Font
dots = DotDisplay(Point=[pt_3, pt_4], Colour=ColourSwatch(SwatchColor=RGB(2, 205, 153)), Size=Slider(14, range=0..100))
dot_2 = AnnotationDot(AnnotationDot=dot.AnnotationDot, Location=pt_4, PrimaryText="Destination")  # -> AnnotationDot, Location, PrimaryText, SecondaryText, TextHeight, Font

# ----
rgb = ColourRGB(Alpha="153", Red=argb.Red, Green=argb.Green, Blue=argb.Blue)

# ---- group: Generate buildings
swatch_5 = ColourSwatch(SwatchColor=RGBA(2, 124, 153, 177))
swatch_6 = ColourSwatch(SwatchColor=RGBA(100, 103, 102, 159))
preview = CustomPreview(Geometry=geo, Material=rgb)

# ----
splitstr = SplitStreetCurves(SplitStreetCurves=flatten(crv_2), IntersectionTolerance=1e-12)  # -> ProcessedStreetCurves, Metadata

# ---- group: Street names
lookup = LookupMetadata(MetadataGeometry=flatten(importosm_2.Metadata), SearchKey="name")
hframe = HorizontalFrame(Curve=reparameterize(splitstr.ProcessedStreetCurves), Parameter=Slider(0.5, range=0..1))
tag = TextTag3D(
    Location=hframe,
    Text=lookup,
    Size=Slider(4, range=0..10),
    Colour=ColourSwatch(SwatchColor=RGB(0, 0, 0)),
    Justification=7)

# ----
panel_6 = Panel(lookup)

# ---- group: Dataframe Details
py3_3 = Python3Script(dataFrame=py3_2)  # -> info, column_name, head_x10, tail_x10, shape, number_of_null_values
# ---------- py3_3: Python ----------
info = dataFrame.info

head_x10 = dataFrame.head(10)
tail_x10 = dataFrame.tail(10)
shape = dataFrame.shape

#Add up all null values
number_of_null_values = dataFrame.isnull().sum()



# columns = dataFrame.columns
# Get the columns as a list
column_name = dataFrame.columns.tolist()

# Output the list
# print(column_name)
# ---------- end py3_3 ----------

# ----
lng = ListLength(List=splitstr.ProcessedStreetCurves)
number_of_segments = Panel(lng)

# ---- group: New router gets more than one optimal route / Sensations - options
myslider = Slider(4, range=0..5)

# ----
panel_7 = Panel(py3_3.column_name)
swatch_7 = ColourSwatch(SwatchColor=RGB(255, 0, 128))

perception_list = ValueList({"acoustic comfort": 6, "thermal comfort": 7, "somatic stress": 8, "social vitality": 9, "territorial safety": 10, "olfactory resonance": 11}, selected="acoustic comfort")
item = ListItem(List=py3_3.column_name, Index=perception_list, Wrap=True)

filter = StreamFilter(
    Gate=perception_list,
    Stream6="Acoustic comfort",
    Stream7="Thermal comfort",
    Stream8="Somatic stress",
    Stream9="Social vitality",
    Stream10="Territorial safety",
    Stream11="Olfactory resonance")
texttoscreen = RenderTextToScreen(
    Text=filter,
    Location="100,100",
    Size=Slider(32, range=0..100),
    Color=ColourSwatch(SwatchColor=RGB(255, 255, 255)),
    Font="consolas",
    m_scWithvp=False)

panel_8 = Panel("poppins")

# ---- group: attach to edges / insert street segments
crv_3 = Curve(streetnet.StreetSegmentCurves)

# ---- group: attach to edges / distance threshold
number_slider_2 = Slider(5, range=0..100)

# ----
Z = UnitZ(Factor=Slider(-10, range=-10..10))
number_slider_3 = Slider(300, range=0..1000)  # disabled
toggle = BooleanToggle(True)  # disabled
panel_9 = Panel("0.2")  # disabled
panel_10 = Panel("1350")  # disabled
panel_11 = Panel("850")  # disabled

# ----
# Perception (9s)
bounding_box = Relay()

# ----
# LLM Walkability Perception
panel_12 = Panel(py3_3.head_x10)
importshp = ImportShapefileFeatures(
    ShapefilePath=py3.shp_file,
    Reproject=False,
    UTMZone=streetnet.UTMZone,
    TranslationVector=streetnet.TranslationVector,
    CroppingGeometry=bounding_box)  # -> simplify(flatten(Points)), Metadata, UTMZone, TranslationVector
demeta = DeconstructMetadata(Metadata=importshp.Metadata)  # -> Keys, Values
panel_14 = Panel(demeta.Values)
panel_15 = Panel(demeta.Keys)

panel_16 = Panel(importshp.Points)

# ----
# FILTERING
lookup_2 = LookupMetadata(MetadataGeometry=importshp.Metadata, SearchKey=item)
pt_5 = Point(flatten(importshp.Points))

bnd = Bounds(Numbers=lookup_2)
dedomain = DeconstructDomain(Domain=bnd)  # -> Start, End
panel_17 = Panel(dedomain.Start)
panel_18 = Panel(dedomain.End)

dots_2 = DotDisplay(Point=pt_5, Colour=ColourSwatch(SwatchColor=RGB(238, 95, 131)), Size=Slider(5, range=0..20))
dup_pts = CleanDuplicatePoints(Points=pt_5, Tolerance=0.01)  # -> Points, Indices, Status
dispatch = Dispatch(List=lookup_2, DispatchPattern=dup_pts.Status)  # -> ListA, ListB
panel_19 = Panel(dispatch.ListA)

points = PointList(Points=pt_5, Size=Slider(6, range=0..10))

# ---- group: raw
tag_2 = TextTag(Location=pt_5, Text=lookup_2)

# ---- group: eliminated duplicates
tag_3 = TextTag(Location=flatten(dup_pts.Points), Text=dispatch.ListA, Colour=ColourSwatch(SwatchColor=RGB(0, 0, 0)))

# ---- group: attach to edges / Insert points
pt_6 = Point(dup_pts.Points)

# ----
num = Number(dispatch.ListA)

item_2 = ListItem(List=py3_3.column_name, Index=Slider(5, range=0..42), Wrap=True)
lookup_3 = LookupMetadata(MetadataGeometry=importshp.Metadata, SearchKey=item_2)
dispatch_2 = Dispatch(List=lookup_3, DispatchPattern=dup_pts.Status)  # -> ListA, ListB

# ---- group: Geometric route
swatch_8 = ColourSwatch(SwatchColor=RGB(0, 255, 0))

# ---- group: New router gets more than one optimal route
number_slider_4 = Slider(20, range=1..20)
n_shortest_routes = Python3Script(Lines=splitstr.ProcessedStreetCurves, StartPt=pt_3, EndPt=pt_4, Penalty="10.0", K=Slider(30, range=1..50))  # -> out, Routes, RouteIndices; inputs Lines: list of Curve, StartPt: Point3d, EndPt: Point3d, Penalty: Double, K: Int32
#   port Lines: Lines to convert to network.
#   port StartPt: Origin point.
#   port EndPt: Destination point.
#   port Penalty: Edge penalization to control how drastically the routes are forced to diverge. This, at the same time, forces the algorithm to give distinctive, alternative routes. A good starting point is 10.0
#   port K: Number of routes to be generated.
#   port Routes: Generated n routes.
#   port RouteIndices: Indices for line segments within routes.
# ---------- n_shortest_routes: Python ----------
#! python 3
# r: networkx

import rhinoscriptsyntax as rs
import Rhino.Geometry as rg
import networkx as nx

# NEW: Import Grasshopper's native Data Tree modules
import Grasshopper
from Grasshopper.Kernel.Data import GH_Path
import System

def get_distinct_paths_with_indices(curves, start_pt, end_pt, k, penalty_factor):
    if isinstance(curves, rg.Curve):
        curves = [curves]
        
    G = nx.Graph()
    
    def pt_to_key(pt):
        return (round(pt.X, 3), round(pt.Y, 3), round(pt.Z, 3))
        
    edge_geometries = {}
    edge_indices = {} 
    
    print("1. Building graph...")
    for original_idx, crv in enumerate(curves):
        if not crv: continue
        
        segments_to_process = []
        if crv.IsPolyline():
            success, polyline = crv.TryGetPolyline()
            if success:
                for seg in polyline.GetSegments():
                    segments_to_process.append(rg.LineCurve(seg))
        else:
            segments_to_process.append(crv)
            
        for seg_crv in segments_to_process:
            p1 = seg_crv.PointAtStart
            p2 = seg_crv.PointAtEnd
            
            k1 = pt_to_key(p1)
            k2 = pt_to_key(p2)
            
            length = seg_crv.GetLength()
            
            G.add_edge(k1, k2, weight=length)
            
            edge_geometries[(k1, k2)] = seg_crv
            edge_geometries[(k2, k1)] = seg_crv 
            edge_indices[(k1, k2)] = original_idx
            edge_indices[(k2, k1)] = original_idx
            
    if len(G.nodes) == 0:
        print("Error: No valid lines were provided.")
        return [], []

    def find_closest_node(graph, target_pt):
        closest_node = None
        min_dist = float('inf')
        for node in graph.nodes:
            node_pt = rg.Point3d(node[0], node[1], node[2])
            dist = target_pt.DistanceTo(node_pt)
            if dist < min_dist:
                min_dist = dist
                closest_node = node
        return closest_node

    start_key = find_closest_node(G, start_pt)
    end_key = find_closest_node(G, end_pt)
    
    k_paths_curves = []
    k_paths_indices = [] 
    
    print("2. Calculating distinctly penalized paths...")
    for i in range(k):
        try:
            path = nx.shortest_path(G, source=start_key, target=end_key, weight='weight')
            
            path_curves = []
            raw_path_indices = []
            
            for j in range(len(path) - 1):
                node_a = path[j]
                node_b = path[j+1]
                
                path_curves.append(edge_geometries[(node_a, node_b)])
                raw_path_indices.append(edge_indices[(node_a, node_b)])
                
                current_weight = G[node_a][node_b]['weight']
                G[node_a][node_b]['weight'] = current_weight * penalty_factor
                
            joined_curves = rg.Curve.JoinCurves(path_curves)
            if joined_curves:
                k_paths_curves.append(joined_curves[0])
                
                clean_indices = []
                for idx in raw_path_indices:
                    if not clean_indices or clean_indices[-1] != idx:
                        clean_indices.append(idx)
                
                k_paths_indices.append(clean_indices)
                
        except nx.NetworkXNoPath:
            print(f"Stopped early at {i} routes: No more valid alternative paths exist.")
            break
        except Exception as e:
            print("An error occurred: " + str(e))
            break
            
    print(f"Success: Found {len(k_paths_curves)} distinct routes.")
    
    # NEW: Convert the nested Python list into a strict Grasshopper Data Tree
    gh_tree = Grasshopper.DataTree[System.Object]()
    for branch_index, indices_list in enumerate(k_paths_indices):
        path = GH_Path(branch_index)
        for index_val in indices_list:
            gh_tree.Add(index_val, path)
            
    return k_paths_curves, gh_tree

if Lines and StartPt and EndPt and K and Penalty:
    Routes, RouteIndices = get_distinct_paths_with_indices(Lines, StartPt, EndPt, K, Penalty)
# ---------- end n_shortest_routes ----------

# ---- group: Geometric route (continued)
branch = BranchByIndex(Tree=n_shortest_routes.RouteIndices, Branch=Slider(0, range=0..10))
item_3 = ListItem(List=n_shortest_routes.Routes, Index=0, Wrap=True)
item_4 = ListItem(List=crv_2, Index=branch, Wrap=True)
len = Length(Curve=item_3)
path_distance = Panel(len)
previewlw_2 = CustomPreviewLineweights(Geometry=item_4, Shader=swatch_8, Thickness=Slider(3, range=0..10), Absolute=False)

# ----
lng_2 = ListLength(List=n_shortest_routes.Routes)
index = ItemIndex(List=n_shortest_routes.Routes, Item=n_shortest_routes.Routes)
gradient = Gradient(
    LowerLimit=0,
    UpperLimit=lng_2,
    Parameter=index,
    stops=[0: RGB(243, 57, 0), 0.1: RGB(236, 27, 60), 0.2: RGB(210, 0, 118), 0.3: RGB(103, 0, 120), 0.4: RGB(39, 72, 161), 0.5: RGB(1, 192, 229), 0.6: RGB(18, 178, 90), 0.7: RGB(79, 186, 8), 0.8: RGB(220, 237, 32), 0.9: RGB(247, 159, 20), 1: RGB(243, 57, 0)])
int = Integer(path_distance)
len_2 = Length(Curve=n_shortest_routes.Routes)
concat = Concatenate(FragmentA="Geometric path: ", FragmentB=int, FragmentC="m")
panel_20 = Panel(len_2)
texttoscreen_2 = RenderTextToScreen(Text=concat, Location="100,220", Size=12, Color=swatch_8, m_scWithvp=False)
panel_21 = Panel(gradient)
previewlw_3 = CustomPreviewLineweights(Geometry=n_shortest_routes.Routes, Shader=gradient, Thickness="7", Absolute=False)

# ---- group: Column Values 001
py3_4 = Python3Script(dataFrame=py3.GeoDataFrame, column_name="acoustic")  # -> columnValues
# ---------- py3_4: Python ----------
columnValues = dataFrame[column_name].tolist()
# ---------- end py3_4 ----------

# ----
viewer = ParamViewer(py3_4)
panel_22 = Panel(py3_4)

# ---- group: attach to edges
midpt = CurveMiddle(Curve=crv_3)
pull = PullPoint(Point=pt_6, Geometry=graft(midpt), ClosestOnly=True)  # -> ClosestPoint, Distance, Index
avr = Average(Input=num)
number_slider_5 = Slider(9, range=0..10)
panel_24 = Panel(avr)
smaller = SmallerThan(FirstNumber=pull.Distance, SecondNumber=number_slider_2)  # -> SmallerThan, OrEqualTo
dispatch_3 = Dispatch(List=pull.ClosestPoint, DispatchPattern=smaller.SmallerThan)  # -> ListA, ListB
dispatch_4 = Dispatch(List=dispatch.ListA, DispatchPattern=smaller.SmallerThan)  # -> ListA, ListB
pt_7 = Point(dispatch_3.ListA)
points_2 = PointList(Points=flatten(pt_7), Size=number_slider_5)
panel_25 = Panel(pt_7)

# ---- group: attach to edges / check index
points_3 = PointList(Points=flatten(midpt), Size=number_slider_5)

# ---- group: attach to edges / Output: reordered data
data = Data(dispatch_4.ListA)

# ---- group: attach to edges (continued)
item_5 = ListItem(List=data, Index=0, Wrap=True)
panel_26 = Panel(item_5)
bnd_2 = Bounds(Numbers=flatten(item_5))
nullrep = ReplaceNulls(Items=item_5, Replacements="0")  # -> flatten(Items), Count
dedomain_2 = DeconstructDomain(Domain=bnd_2)  # -> Start, End
gradient_2 = Gradient(
    LowerLimit=Slider(100, range=0..100),
    UpperLimit=Slider(0, range=0..100),
    Parameter=nullrep.Items,
    stops=[0: RGB(27, 117, 166), 0.125: RGB(0, 163, 191), 0.25: RGB(0, 201, 188), 0.375: RGB(135, 237, 161), 0.5: RGB(224, 224, 45), 0.625: RGB(250, 208, 82), 0.75: RGB(250, 160, 50), 0.875: RGB(232, 111, 30), 1: RGB(191, 40, 23)])
panel_27 = Panel(nullrep.Items)
col = Colour(gradient_2)
panel_28 = Panel(col)
previewlw_4 = CustomPreviewLineweights(Geometry=crv_3, Shader=col, Thickness=Slider(3, range=0..10), Absolute=False)

# ---- group: Check individual segments
item_6 = ListItem(List=nullrep.Items, Index="126", Wrap=True)
item_7 = ListItem(List=crv_3, Index="126", Wrap=True)
panel_29 = Panel(item_7)
panel_30 = Panel(item_6)

# ---- group: attach to edges / matched & filtered
tag_4 = TextTag(Location=midpt, Text=flatten(nullrep.Items))

# ---- group: Select cylinder
dispatch_5 = Dispatch(List=dispatch_2.ListA, DispatchPattern=smaller.SmallerThan)  # -> ListA, ListB
item_8 = ListItem(List=dispatch_5.ListA, Index=0, Wrap=True)
nullrep_2 = ReplaceNulls(Items=item_8, Replacements="No image")  # -> flatten(Items), Count
node_selection = Slider(15, range=0..100)
item_9 = ListItem(List=nullrep_2.Items, Index=n_shortest_routes.RouteIndices, Wrap=True)

# ---- group: perception scores
item_10 = ListItem(List=nullrep.Items, Index=n_shortest_routes.RouteIndices, Wrap=True)
viewer_2 = ParamViewer(item_10)
num_2 = Number(item_10)
avr_2 = Average(Input=num_2)  # -> flatten(ArithmeticMean)
listdexs = ListIndices(List=avr_2)
panel_32 = Panel(avr_2)
sort = SortList(Keys=avr_2, ValuesA=listdexs)  # -> reverse(Keys), reverse(ValuesA)
equals = Equality(FirstNumber=sort.Keys, SecondNumber=perception_list)  # -> Equality, Inequality
panel_33 = Panel(equals.Equality)
panel_34 = Panel(sort.ValuesA)
panel_35 = Panel(sort.Keys)
item_11 = ListItem(List=sort.ValuesA, Index=0, Wrap=True)
branch_2 = BranchByIndex(Tree=item_10, Branch=item_11)
int_2 = Integer(branch_2)
avr_3 = Average(Input=int_2)
int_3 = Integer(avr_3)
panel_36 = Panel(branch_2)
concat_2 = Concatenate(FragmentA="Average perception score: ", FragmentB=int_3)

# ---- group: New router gets more than one optimal route (continued)
item_12 = ListItem(List=n_shortest_routes.Routes, Index=item_11, Wrap=invert(True))

# ----
previewlw_5 = CustomPreviewLineweights(Geometry=item_12, Shader=swatch_7, Thickness="7", Absolute=False)
len_3 = Length(Curve=item_12)
path_distance_2 = Panel(len_3)

# ---- group: Color selected path and cylinder
item_13 = ListItem(List=gradient, Index=item_11, Wrap=True)
argb_2 = SplitARGB(Colour=item_13, IntegerChannels=True)  # -> Alpha, Red, Green, Blue
rgb_2 = ColourRGB(Alpha=Slider(124, range=0..255), Red=argb_2.Red, Green=argb_2.Green, Blue=argb_2.Blue)

# ----
int_4 = Integer(path_distance_2)
concat_3 = Concatenate(FragmentA="Sensorial path: ", FragmentB=int_4, FragmentC="m")
crvtoscreen_2 = RenderCurveToScreen(
    Curve=item_12,
    Location="50,900",
    ScaleFactor=number_slider,
    Color=swatch_7,
    Thickness=Slider(2, range=0..10),
    Depth="1",
    Fixed=True,
    m_scWithvp=False)
texttoscreen_3 = RenderTextToScreen(Text=concat_3, Location="100,170", Size=12, Color=swatch_7, m_scWithvp=False)

# ---- group: Select cylinder (continued)
branch_3 = BranchByIndex(Tree=item_9, Branch=item_11)
item_14 = ListItem(List=branch_3, Index=node_selection, Wrap=True)

# ---- group: Pulse curve
branch_4 = BranchByIndex(Tree=n_shortest_routes.RouteIndices, Branch=item_11)
dom = ConstructDomain(DomainStart=0, DomainEnd=Slider(50, range=0..100))
remap = RemapNumbers(Value=branch_2, Source="0 to 100", Target=dom)  # -> Mapped, Clipped
item_15 = ListItem(List=crv_3, Index=branch_4, Wrap=True)
Z_2 = UnitZ(Factor=remap.Mapped)
midpt_2 = CurveMiddle(Curve=item_15)
move = Move(Geometry=midpt_2, Motion=Z_2)  # -> Geometry, Transform
swatch_9 = ColourSwatch(SwatchColor=RGB(255, 255, 0))
pline_3 = PolyLine(Vertices=move.Geometry, Closed=False)
previewlw_6 = CustomPreviewLineweights(Geometry=pline_3, Shader=swatch_9, Thickness=Slider(1, range=0..10), Absolute=False)

# ---- group: perception scores (continued)
texttoscreen_4 = RenderTextToScreen(Text=concat_2, Location="100,150", Size=12, Color=swatch_9, m_scWithvp=False)

# ---- group: Score display
Z_3 = UnitZ(Factor=Slider(10, range=0..100))
move_2 = Move(Geometry=move.Geometry, Motion=Z_3)  # -> Geometry, Transform
dots_3 = DotDisplay(Point=move.Geometry, Colour=swatch_9, Size=Slider(3, range=0..10))
tag_5 = TextTag(Location=move_2.Geometry, Text=branch_2, Colour=swatch_9)
tag_6 = TextTag3D(Location=move.Geometry, Text=branch_2, Size=Slider(23, range=0..100), Colour=swatch_9, Justification=7)

# ----
move_3 = Move(Geometry=move.Geometry, Motion=Z)  # -> Geometry, Transform
listdexs_2 = ListIndices(List=move_3.Geometry)
concat_4 = Concatenate(FragmentA="node", FragmentB=listdexs_2, JoinSeparator=" ")
tag_7 = TextTag(Location=move_3.Geometry, Text=concat_4, Colour=swatch_9)

# ---- group: Selected path division and cylinder
ln = Line(StartPoint=midpt_2, EndPoint=move.Geometry)
end = EndPoints(Curve=ln)  # -> Start, End
cir = Circle(Plane=end.End, Radius=Slider(70, range=0..100))
Z_4 = UnitZ(Factor=Slider(40, range=0..100))
extr = Extrude(Base=cir, Direction=Z_4)
item_16 = ListItem(List=extr, Index=node_selection, Wrap=True)
preview_2 = CustomPreview(Geometry=item_16, Material=ColourSwatch(SwatchColor=RGBA(255, 255, 0, 126)))

# ----
item_17 = ListItem(List=ln, Index=node_selection, Wrap=True)

# ---- group: Selected path division and cylinder (continued)
previewlw_7 = CustomPreviewLineweights(Geometry=item_17, Shader=swatch_9, Thickness="3", Absolute=False)

# ---- group: Dot image sampling
srf = Surface(reparameterize(item_16))  # disabled
number_slider_6 = Slider(200, range=1..200)  # disabled
directory = Panel("C:\Users\l03063058\Desktop\Github\DRVaa\streetview_panoramas_360\")  # disabled
panel_37 = Panel("10")  # disabled
division = Division(A=number_slider_6, B=panel_37)  # disabled
concat_5 = Concatenate(FragmentA=directory, FragmentB=item_14)  # disabled
sdivide = DivideSurface(Surface=reparameterize(srf), UCount=division, VCount=number_slider_6)  # -> flatten(Points), Normals, flatten(Parameters); disabled
path_4 = FilePath(concat_5)  # disabled
filepath_for_image_sampler = Python3Script(file_path=path_4)  # inputs file_path: String; disabled
# ---------- filepath_for_image_sampler: Python ----------
import Grasshopper as gh
import System.Reflection as reflection
import os

doc = ghenv.Component.OnPingDocument()

if file_path and os.path.exists(file_path):
    for obj in doc.Objects:
        if isinstance(obj, gh.Kernel.Special.GH_ImageSampler) and obj.NickName == "MySampler":
            if obj.ImageFilePath != file_path:
                # 1. Set new file path string
                obj.ImageFilePath = file_path
                
                # 2. Force reload of the internal bitmap memory cache using Reflection
                flags = reflection.BindingFlags.Instance | reflection.BindingFlags.NonPublic | reflection.BindingFlags.Public
                method = obj.GetType().GetMethod("LoadImage", flags) or obj.GetType().GetMethod("ReloadImage", flags)
                
                if method:
                    method.Invoke(obj, None)
                
                # 3. Re-evaluate downstream Grasshopper components
                obj.ExpireSolution(True)
            break
# ---------- end filepath_for_image_sampler ----------
mysampler = ImageSampler(
    sdivide.Parameters,
    FilePath="C:\Users\l03063058\Desktop\Github\DRVaa\streetview_panoramas_360\w8pdf9pURAi1ksyVknMrEQ_360.jpg",
    Filter="Colour",
    Interpolate=False,
    Umax=1,
    Umin=0,
    Vmax=1,
    Vmin=0,
    Wrap=1)  # disabled
panel_38 = Panel(path_4)  # disabled
number_slider_7 = Slider(100, range=1..255)  # disabled
argb_3 = SplitARGB(Colour=mysampler, IntegerChannels=True)  # -> Alpha, Red, Green, Blue; disabled
rgb_3 = ColourRGB(Alpha=number_slider_7, Red=argb_3.Red, Green=argb_3.Green, Blue=argb_3.Blue)  # -> simplify(Colour); disabled
dots_4 = DotDisplay(Point=sdivide.Points, Colour=rgb_3, Size=1)  # disabled

# ----
render_image_to_screen = Python3Script(file_path=path_4, screen_x=panel_10, screen_y=panel_11, scale=panel_9, enabled=toggle)  # inputs file_path: String, screen_x: Int32, screen_y: String, scale: Double, enabled: Boolean; disabled
# ---------- render_image_to_screen: Python ----------
import Rhino
import System.Drawing as drawing
import scriptcontext as sc
import os

class ImageConduit(Rhino.Display.DisplayConduit):
    def __init__(self, path, x, y, scale_factor=1.0):
        super().__init__()
        self.x = int(x)
        self.y = int(y)
        self.display_bmp = None
        self.scaled_bmp = None
        self.sys_bmp = None
        
        if path and os.path.exists(path):
            try:
                # Load system bitmap
                self.sys_bmp = drawing.Bitmap(path)
                
                # Compute resampled dimensions
                sf = max(0.01, float(scale_factor))
                w = max(1, int(self.sys_bmp.Width * sf))
                h = max(1, int(self.sys_bmp.Height * sf))
                
                # Create scaled system bitmap
                self.scaled_bmp = drawing.Bitmap(self.sys_bmp, w, h)
                
                # Generate GPU-compatible DisplayBitmap
                self.display_bmp = Rhino.Display.DisplayBitmap(self.scaled_bmp)
            except Exception as ex:
                print("Error loading bitmap:", ex)

    def CalculateBoundingBox(self, e):
        super().CalculateBoundingBox(e)
        # Force pipeline execution even when 3D geometry is absent
        e.IncludeBoundingBox(Rhino.Geometry.BoundingBox(Rhino.Geometry.Point3d(-10, -10, -10), Rhino.Geometry.Point3d(10, 10, 10)))

    def DrawForeground(self, e):
        # Draw directly in screen pixel space (top-left origin = 0,0)
        if self.display_bmp:
            e.Display.DrawBitmap(self.display_bmp, self.x, self.y)

    def Dispose(self):
        if self.display_bmp:
            self.display_bmp.Dispose()
            self.display_bmp = None
        if self.scaled_bmp:
            self.scaled_bmp.Dispose()
            self.scaled_bmp = None
        if self.sys_bmp:
            self.sys_bmp.Dispose()
            self.sys_bmp = None

# --- CONDUIT MANAGEMENT ---
# Clear existing conduit instance from persistent sticky memory
if "image_conduit" in sc.sticky and sc.sticky["image_conduit"] is not None:
    old_conduit = sc.sticky["image_conduit"]
    old_conduit.Enabled = False
    try:
        old_conduit.Dispose()
    except Exception:
        pass
    sc.sticky["image_conduit"] = None

# Safely extract component inputs
run_enabled = globals().get('enabled', True)
path_val = globals().get('file_path', None)
x_val = globals().get('screen_x', 50)
y_val = globals().get('screen_y', 50)
scale_val = globals().get('scale', 1.0)

# Strip surrounding quotes if path was passed as a literal string
if path_val and isinstance(path_val, str):
    path_val = path_val.strip('\'"')

# Enable new conduit if file path exists
if run_enabled and path_val and os.path.exists(path_val):
    conduit = ImageConduit(path_val, x_val, y_val, scale_val)
    conduit.Enabled = True
    sc.sticky["image_conduit"] = conduit

# Force active viewport redraw
if Rhino.RhinoDoc.ActiveDoc:
    Rhino.RhinoDoc.ActiveDoc.Views.Redraw()
# ---------- end render_image_to_screen ----------
